# Grasshopper definition rd_mesh.gh (Grasshopper 1.0.7)
# plug-ins: HAL for Grasshopper, Kangaroo2 Components, PlanktonGh, Exoskeleton2, LunchBoxML

# ---- group: Mesh ball Blank
number_slider = Slider(50, range=0..100)
msphere = MeshSphere(Base=PlaneXY(0, 0, 0), Radius=Slider(63, range=0..100), UCount=number_slider, VCount=number_slider)
number_slider_2 = Slider(50, range=0..100)
triremesh = TriRemesh(Geometry=msphere, Length=Slider(2, range=0..10), Iterations=number_slider_2)  # -> Triangulation, Dual, Creases

# ----
number_slider_3 = Slider(6, range=0..10)

# ---- group: remesh by color (K2)
mesh = Mesh(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)

# ---- group: Mesh Ball (6seed)
mesh_2 = Mesh(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)

# ---- group: simple_vase_open_low_res_2
mesh_3 = Mesh(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)

# ----
sessionsettings = SessionSettings()

# ---- group: Current Dir
python = GhPythonScript()  # -> out, a
# ---------- python: Python ----------
import rhinoscriptsyntax as rs

file_name = ghenv.Component.OnPingDocument().FilePath

print(file_name)
# ---------- end python ----------
panel = Panel(python.out)

# ----
triremesh_2 = TriRemesh(Geometry=mesh_3, Length=number_slider_3, Iterations=number_slider_2)  # -> Triangulation, Dual, Creases

tc = TangentCircles(Mesh=mesh_2)  # -> Incircles, CirclePacking, Dual
circle = Circle(tc.Incircles)
circle_2 = Circle(tc.CirclePacking)
crv = Curve(tc.Dual)

# ---- group: Plankton Mesh
triremesh_3 = TriRemesh(Geometry=mesh_2, Length=Slider(5, range=0..10), Iterations=25)  # -> Triangulation, Dual, Creases
demesh = DeconstructMesh(Mesh=triremesh_3.Triangulation)  # -> Vertices, Faces, Colours, Normals
pmesh = PlanktonMesh(triremesh_3.Triangulation)
planktonfrompoints = PlanktonFromPoints(PMesh=pmesh, Vertices=demesh.Vertices)
deconstructplankton = DeconstructPlankton(PMesh=planktonfrompoints)  # -> Vertex_Points, Vertex_Outgoing_Halfedge, Halfedge_StartVertex, Halfedge_AdjacentFace, Halfedge_NextHalfedge, Halfedge_PrevHalfedge, Halfedge_Pair, Face_Halfedge
cyto = Cytoskeleton(PlanktonMesh=planktonfrompoints, Radius=Slider(0.84, range=0..1), Dual=Toggle(True))

# ----
mesh_4 = Mesh(triremesh_2.Triangulation)
demesh_2 = DeconstructMesh(Mesh=mesh_4)  # -> Vertices, Faces, Colours, Normals
rtree = CreateRTree(InputGeometry=demesh_2.Vertices)

# ---- group: get convolution groups
mesh_len_scaler = Slider(1.5, range=1..2)
multiplication = Multiplication(A=number_slider_3, B=mesh_len_scaler)

# *result should only include nearest neighbors
number_slider_4 = Slider(20, range=0..100)
lng = ListLength(List=demesh_2.Vertices)
series = Series(Start=0, Step=1, Count=lng)
popgeo = PopulateGeometry(Geometry=mesh_4, Count=number_slider_4, Seed=1)
item = ListItem(List=demesh_2.Vertices, Index=series, Wrap=True)
rtree_range = RTreePointsInRange(SearchPoints=popgeo, SearchDistance=Slider(5, range=0..10), RTree=rtree)  # -> PointsWithinRange, IndicesWithinRange
rtree_range_2 = RTreePointsInRange(SearchPoints=item, SearchDistance=multiplication, RTree=rtree)  # -> PointsWithinRange, IndicesWithinRange

# ---- group: convolution_indices
int = Integer(simplify(rtree_range_2.IndicesWithinRange))

# ---- group: seed
int_2 = Integer(rtree_range.IndicesWithinRange)

# ---- group: Avg # of convolution indices
viewer = ParamViewer(int)
lng_2 = ListLength(List=int)  # -> flatten(Length)
avr = Average(Input=lng_2)

# ---- group: Write Json
python_2 = GhPythonScript(Dump=Button(), Pts=demesh_2.Vertices, conv_indices=int, S=flatten(int_2))  # -> out; inputs Dump: Boolean, Pts: list of Point3d, conv_indices: tree of Int32, S: list of Int32
# ---------- python_2: Python ----------
#https://stackoverflow.com/questions/25924244/creating-2d-dictionary-in-python

import rhinoscriptsyntax as rs
import json
import Grasshopper as gh
import ghpythonlib.treehelpers as th

##1D dict structure EXAMPLE
#sample_dict = {'pts':{}}
#sample_dict['pts']['pt'] = {'X': 1.5, 'Y': 2.5, 'Z': 3.5}
##print(sample_dict)
#
##2D dict structure EXAMPLE
#sample_2Ddict = {'pts':[]}
#sample_2Ddict['pts'].append({'pt': {'X': 1.5, 'Y': 2.5, 'Z': 3.5}})
##print(sample_2Ddict)

output = {}

#convert to list of list
ci_list = []
for i in range(conv_indices.BranchCount):
    branchList = conv_indices.Branch(i)
    branchPath = conv_indices.Path(i)
    ci_list.append([])
    for j in range(branchList.Count):
        ci_list[i].append(branchList[j])
        
#make dictionary
ci_dict = {'convolution_indices':[]}
for i in range(len(ci_list)):
    ci_dict['convolution_indices'].append([])
    for j in range(len(ci_list[i])):
        ci_dict['convolution_indices'][i].append(ci_list[i][j])
output.update(ci_dict)

#add seed
seed_dict = {'seed_indices':[]}
for i in S:
    seed_dict['seed_indices'].append(i)
output.update(seed_dict)

if Dump:
    with open(r"C:\Users\Prinz\Desktop\Projects\ISF\reaction_diffusion_repo\rd_existing_mesh\data\existing_mesh_data.json", 'w') as f:
        json.dump(output, f, indent=4)
        f.close()
        print("json updated")

print("see existing_mesh_data.json")
# ---------- end python_2 ----------
panel_2 = Panel(python_2)

# ---- group: should read atleast 6
panel_3 = Panel(avr)

# ---- group: Open Json
path = FilePath("C:\Users\Prinz\Desktop\Projects\ISF\reaction_diffusion_repo\rd_existing_mesh\data\results.json")
python_3 = GhPythonScript(FilePath=path)  # -> out, vertex_values
# ---------- python_3: Python ----------
import rhinoscriptsyntax as rs
import json

# Opening JSON file
f = open(FilePath)
  
# returns JSON object as a dictionary
data = json.load(f)

vertex_values = data['vertex_values']
# ---------- end python_3 ----------

# ----
rgb = ColourRGB(Alpha=255, Red=python_3.vertex_values, Green=python_3.vertex_values, Blue=python_3.vertex_values)
mcol = MeshColours(Mesh=mesh_4, Colours=rgb)
cloud = CloudDisplay(Points=demesh_2.Vertices, Colours=rgb, Size=Slider(2.3, range=0..10), SpriteType=0)

# ---- group: Color Mesh
dom = ConstructDomain(DomainStart="0", DomainEnd="255")
dom_2 = ConstructDomain(DomainStart=Slider(0, range=0..100), DomainEnd=Slider(217, range=0..1000))
remap = RemapNumbers(Value=python_3.vertex_values, Source=dom, Target=dom_2)  # -> Mapped, Clipped
int_3 = Integer(remap.Mapped)
rgb_2 = ColourRGB(Alpha=255, Red=int_3, Green=int_3, Blue=int_3)

# ---- group: Offset Pts
number_slider_5 = Slider(2.2, range=0..10)
dom_3 = ConstructDomain(DomainStart="0", DomainEnd="255")

# ----
neg = Negative(Value=number_slider_5)

# ---- group: Offset Pts (continued)
dom_4 = ConstructDomain(DomainStart=neg, DomainEnd=number_slider_5)
remap_2 = RemapNumbers(Value=python_3.vertex_values, Source=dom_3, Target=dom_4)  # -> Mapped, Clipped
amp = Amplitude(Vector=demesh_2.Normals, Amplitude=remap_2.Mapped)
move = Move(Geometry=demesh_2.Vertices, Motion=amp)  # -> simplify(Geometry), Transform

# ---- group: Make Mesh
conmesh = ConstructMesh(Vertices=flatten(move.Geometry), Faces=demesh_2.Faces)
mcol_2 = MeshColours(Mesh=conmesh, Colours=rgb_2)
